# Dynamo custom node InnerZickZack.dyf (Dynamo 2.10.1.3976)
# category: 3D-Print
# Creates an inner zick zack path from a perimeter path.

code_block = CodeBlock { null; 0; }
dict = Input(dict: var[]..[])
dictToVar = Custom[DictToVar](dict=dict)  # Extracts dictionary content
divisions = Input(divisions: var[]..[])

# group: inner Zick Zack
createAccess = Custom[CreateAccess](nozzleD=dictToVar.nozzleD, outerPrintingPath=dictToVar.path, accessIdx=dictToVar.accIdx)  # Cuts surrounding printing path at access point and returns access geometry
create_perimeter_offset_and = CodeBlock(perimeter=dictToVar.perimeter, nozzleD=dictToVar.nozzleD, reversed=dictToVar.reversed, nos=dictToVar.numberOfSolids)  # "Create perimeter offset and reverse it if necessary"
# ---------- create_perimeter_offset_and.designscript (34 lines) ----------
offPer = Autodesk.DesignScript.Geometry.Curve.Offset(perimeter,-nozzleD);
exPer = Geometry.Explode(offPer);
!reversed;
nos;
outerPer = [Imperative]{
if (!reversed)
{
reverted=[];
for (i in 0..List.Count(exPer)-1)
{
reverted[i]=List.Reverse(exPer[i]);
}
return PolyCurve.Reverse(reverted);
}
else
{
return exPer;
}
};
shiftIdx = [Imperative]{
if (!reversed)
{
return 1;
}
else
{
return nos-1;
}
};
outer = List.ShiftIndices(outerPer@L2<1>,shiftIdx);
outerPoly = PolyCurve.ByJoinedCurves(outer,0.0001);
offOuter = Autodesk.DesignScript.Geometry.Curve.Offset(outerPoly,-nozzleD);
inner = Geometry.Explode(offOuter);
middleCurve = List.GetItemAtIndex(outer@L2<1>,nos);
# ----------------------------------------
removeSides = Custom[RemoveSides](geometry=create_perimeter_offset_and.out6, numberOfSolids=dictToVar.numberOfSolids)  # Removes the sides of a perimeter curve by bool mask.
code_block_2 = CodeBlock(c=removeSides.outerBorder, nozzleD=dictToVar.nozzleD)
# ---------- code_block_2.designscript (4 lines) ----------
curves = PolyCurve.Curves(c);
len = Autodesk.DesignScript.Geometry.Curve.Length(curves);
off1 = nozzleD/len;
off2 = 1-off1;
# ----------------------------------------
trimByParameter = Curve.TrimByParameter(curve=code_block_2.curves@L2, startParameter=code_block_2.off1@L2, endParameter=code_block_2.off2@L2)
transpose = List.Transpose(lists=trimByParameter)
removeSides_2 = Custom[RemoveSides](geometry=create_perimeter_offset_and.out9, numberOfSolids=dictToVar.numberOfSolids)
code_block_3 = CodeBlock(c=removeSides_2.innerBorder, nozzleD=dictToVar.nozzleD)  # same code as code_block_2
trimByParameter_2 = Curve.TrimByParameter(curve=code_block_3.curves@L2, startParameter=code_block_3.off1@L2, endParameter=code_block_3.off2@L2)
transpose_2 = List.Transpose(lists=trimByParameter_2)
pointsAtEqualSegmentLength = Curve.PointsAtEqualSegmentLength(curve=transpose, divisions=divisions)
closestPointTo = Geometry.ClosestPointTo(geometry=transpose_2, other=pointsAtEqualSegmentLength)
transpose_3 = List.Transpose(lists=closestPointTo@L3)
code_block_4 = CodeBlock { 2; 1; }
dropEveryNthItem = List.DropEveryNthItem(list=transpose_3@L3, n=code_block_4.out0)
transpose_4 = List.Transpose(lists=pointsAtEqualSegmentLength@L3)
dropEveryNthItem_2 = List.DropEveryNthItem(list=transpose_4@L3, n=code_block_4.out0, offset=code_block_4.out1)
byStartPointEndPoint = Line.ByStartPointEndPoint(startPoint=dropEveryNthItem, endPoint=dropEveryNthItem_2)
restOfItems = List.RestOfItems(list=dropEveryNthItem@L3)
byStartPointEndPoint_2 = Line.ByStartPointEndPoint(startPoint=dropEveryNthItem_2, endPoint=restOfItems)
startPoint = Curve.StartPoint(curve=trimByParameter@L2)
transpose_5 = List.Transpose(lists=startPoint)
firstItem = List.FirstItem(list=dropEveryNthItem@L3)
byStartPointEndPoint_3 = Line.ByStartPointEndPoint(startPoint=transpose_5, endPoint=firstItem)
lastItem = List.LastItem(list=dropEveryNthItem@L3)
endPoint = Curve.EndPoint(curve=trimByParameter@L2)
transpose_6 = List.Transpose(lists=endPoint)
byStartPointEndPoint_4 = Line.ByStartPointEndPoint(startPoint=lastItem, endPoint=transpose_6)
merge_zick_zack_lines_per = CodeBlock(linesDown=byStartPointEndPoint, linesUp=byStartPointEndPoint_2, numberOfSolids=dictToVar.numberOfSolids, numberOfLines=divisions, linesStart=byStartPointEndPoint_3, linesEnd=byStartPointEndPoint_4)  # "Merge zick zack lines per element"
# ---------- merge_zick_zack_lines_per.designscript (22 lines) ----------
linesDown;
linesUp;
numberOfSolids;
numberOfLines;
linesStart;
linesEnd;
linesTotal = [Imperative]{
lines = [];
for (i in 0..numberOfSolids-1)
{
	l = [];
	l[0]=linesStart[i];
	for (j in 0..numberOfLines/2-2)
	{
		l[2*j+1] = linesDown[i][j];
		l[2*j+2] = linesUp[i][j];
	}
	l[numberOfLines-1] = linesEnd[i];
	lines = List.AddItemToEnd(l,lines);
}
return lines;
};
# ----------------------------------------
merge_elements = CodeBlock(refLineOuter=transpose, refLineInner=transpose_2, zickZack=merge_zick_zack_lines_per.out6, numberOfSolids=dictToVar.numberOfSolids)
# ---------- merge_elements.designscript (45 lines) ----------
refLineOuter;
refLineInner;
zickZack;
numberOfSolids;
z = Vector.ZAxis();
outerEndPoints = Autodesk.DesignScript.Geometry.Curve.EndPoint(refLineOuter);
outerStartPoints = Autodesk.DesignScript.Geometry.Curve.StartPoint(refLineOuter);
innerEndPoints = Autodesk.DesignScript.Geometry.Curve.EndPoint(refLineInner);
innerStartPoints = Autodesk.DesignScript.Geometry.Curve.StartPoint(refLineInner);

totalZickZack = [Imperative]{
if (numberOfSolids == 1)
{
	return zickZack;
}
else {
	newZickZack=[];
	newZickZack = List.AddItemToEnd(zickZack[0],newZickZack);
	for (i in 1..numberOfSolids-1)
	{
		l = [];
		a = PolyCurve.TangentAtParameter(refLineOuter[i-1][0],1);
		b = PolyCurve.TangentAtParameter(refLineOuter[i][0],0);
		angle = Vector.AngleAboutAxis(a,b,z);
		if (angle < 180)
		{
			l1 = Line.ByStartPointEndPoint(outerEndPoints[i-1],innerEndPoints[i-1]);
			l2 = Line.ByStartPointEndPoint(innerEndPoints[i-1],innerStartPoints[i]);
			l3 = Line.ByStartPointEndPoint(innerStartPoints[i],outerStartPoints[i]);
			l = [l1,l2,l3];
		}
		else
		{
			l = [Line.ByStartPointEndPoint(outerEndPoints[i-1],outerStartPoints[i])];
		}
		newZickZack = List.AddItemToEnd(l,newZickZack);
		newZickZack = List.AddItemToEnd(zickZack[i],newZickZack);
	}


	return newZickZack;
}
};
tzickzack = List.Transpose(List.Flatten(totalZickZack,1));
zzPolyCurve = PolyCurve.ByJoinedCurves(tzickzack,0.001);
# ----------------------------------------
startCurve = Custom[StartCurve](perimeter=dictToVar.perimeter, reverse=dictToVar.reversed, numberOfSolids=dictToVar.numberOfSolids, nozzleD=dictToVar.nozzleD)  # Creates a offset curve that connects to the outer perimeter
startPoint_2 = Curve.StartPoint(curve=merge_elements.out11)
parameterAtPoint = Curve.ParameterAtPoint(curve=startCurve, point=startPoint_2)
trimByEndParameter = Curve.TrimByEndParameter(curve=startCurve, endParameter=parameterAtPoint)
code_block_5 = CodeBlock(geo=create_perimeter_offset_and.out6, nozzleD=dictToVar.nozzleD)
# ---------- code_block_5.designscript (3 lines) ----------
c=List.LastItem(geo@L2<1>);
startPar=1-nozzleD/Autodesk.DesignScript.Geometry.Curve.Length(c);
Autodesk.DesignScript.Geometry.Curve.TrimByEndParameter(c,startPar);
# ----------------------------------------
endPoint_2 = Curve.EndPoint(curve=code_block_5.out2)
byStartPointEndPoint_5 = Line.ByStartPointEndPoint(startPoint=endPoint_2, endPoint=createAccess.accessPoint)
code_block_6 = CodeBlock(zickZack=merge_elements.out11, middleCurve=create_perimeter_offset_and.out10, firstPart=trimByEndParameter, sideBack=removeSides.innerBorder, last=code_block_5.out2, connect=byStartPointEndPoint_5)
# ---------- code_block_6.designscript (5 lines) ----------
p1 = Autodesk.DesignScript.Geometry.Curve.EndPoint(zickZack);
p2 = Autodesk.DesignScript.Geometry.Curve.StartPoint(middleCurve);
zToMid = Line.ByStartPointEndPoint(p1,p2);
l = [firstPart,zickZack,zToMid,middleCurve,sideBack,last,connect];
PolyCurve.ByJoinedCurves(List.Transpose(l),0.01);
# ----------------------------------------
connect_inner_to_outer_path = CodeBlock(accCurve=createAccess.accessCurve, innerPer=code_block_6.out4, outerPath=dictToVar.path, accIdx=dictToVar.accIdx)
# ---------- connect_inner_to_outer_path.designscript (5 lines) ----------
innerPerAcc = List.ReplaceItemAtIndex(accCurve@L2<1>,1,innerPer@L1<1>);
innerPoly = PolyCurve.ByJoinedCurves(innerPerAcc@L2<1>,0.01);
outerPathEx = Geometry.Explode(outerPath);
totalPath = List.ReplaceItemAtIndex(outerPathEx@L2<1>,accIdx,innerPoly@L1<1>);
Autodesk.DesignScript.Geometry.Curve.Join(List.FirstItem(totalPath@L2<1>),List.RestOfItems(totalPath@L2<1>));
# ----------------------------------------

varToDict = Custom[VarToDict](perimeter=code_block.out0, path=connect_inner_to_outer_path.out4, accIdx=code_block.out1, reversed=create_perimeter_offset_and.out2, numberOfSolids=merge_elements.out3, counter=code_block.out1, nozzleD=dictToVar.nozzleD)  # Creates dictionary from Variables
dict_2 = Output(varToDict)  # "dict"
watch = Watch(code_block_2.len)
